# Dynamo graph Application.Name.dyn (Dynamo 2.16.1.2727)
# packages: OpenMEP 1.0.0

boolean = BoolSelector(true)
current = OpenMEPSandbox.Autocad.Application.Current(toggle=boolean)
name = OpenMEPSandbox.Autocad.Application.Name(AcadApplication=current)
