# Dynamo graph Application.Path.dyn (Dynamo 2.16.1.2727)
# packages: OpenMEP 1.0.0

boolean = BoolSelector(true)
current = OpenMEPSandbox.Autocad.Application.Current(toggle=boolean)
path = OpenMEPSandbox.Autocad.Application.Path(AcadApplication=current)
