# Dynamo graph Block.BlockScaling.dyn (Dynamo 2.17.1.4055)
# packages: OpenMEP 1.0.0

boolean = BoolSelector(true)
current = OpenMEPSandbox.Autocad.Document.Current(toggle=boolean)
database = OpenMEPSandbox.Autocad.Document.Database(AcadDocument=current)
blocks = OpenMEPSandbox.Autocad.Database.Blocks(AcadDatabase=database)
blockScaling = OpenMEPSandbox.Autocad.Block.BlockScaling(AcadBlock=blocks)
