# Dynamo graph BlockReference.ConvertToStaticBlock.dyn (Dynamo 2.16.1.2727)
# packages: OpenMEP 1.0.0

boolean = BoolSelector(true)
current = OpenMEPSandbox.Autocad.Document.Current(toggle=boolean)
cadFilterTypes = CadFilterDropDown("BlockReference")
getCadObjectsByFilters = OpenMEPSandbox.Autocad.Document.GetCadObjectsByFilters(AcadDocument=current, CadFilterType=cadFilterTypes)
code_block = CodeBlock { "Hello"; }
convertToStaticBlock = OpenMEPSandbox.Autocad.BlockReference.ConvertToStaticBlock(AcadBlockReference=getCadObjectsByFilters, newBlockName=code_block)
