# Dynamo graph BlockReference.Handle.dyn (Dynamo 2.16.1.2727)
# packages: OpenMEP 1.0.0

boolean = BoolSelector(true)
current = OpenMEPSandbox.Autocad.Document.Current(toggle=boolean)
cadFilterTypes = CadFilterDropDown("BlockReference")
getCadObjectsByFilters = OpenMEPSandbox.Autocad.Document.GetCadObjectsByFilters(AcadDocument=current, CadFilterType=cadFilterTypes)
handle = OpenMEPSandbox.Autocad.BlockReference.Handle(AcadBlockReference=getCadObjectsByFilters)
