# Dynamo graph Connector.Angle.dyn (Dynamo 2.16.1.2727)
# packages: OpenMEP 1.0.0

select_model_element = DSModelElementSelection()  # 1 picked in the model
getConnectors = OpenMEP.ConnectorManager.Connector.GetConnectors(element=select_model_element)
angle = OpenMEP.ConnectorManager.Connector.Angle(connector=getConnectors)
