# Dynamo graph Connector.CoordinateSystem.dyn (Dynamo 2.16.1.2727)
# packages: OpenMEP 1.0.0

select_model_element = DSModelElementSelection()  # 1 picked in the model
getConnectors = OpenMEP.ConnectorManager.Connector.GetConnectors(element=select_model_element)
code_block = CodeBlock(x=getConnectors) { x[0]; }
coordinateSystem = OpenMEP.ConnectorManager.Connector.CoordinateSystem(connector=code_block)
