# Dynamo graph Connector.DisConnectFrom.dyn (Dynamo 2.16.1.2727)
# packages: OpenMEP 1.0.0

select_model_element = DSModelElementSelection()  # nothing selected
getConnectors = OpenMEP.ConnectorManager.Connector.GetConnectors(element=select_model_element)
select_model_element_2 = DSModelElementSelection()  # nothing selected
getConnectors_2 = OpenMEP.ConnectorManager.Connector.GetConnectors(element=select_model_element_2)
firstItem = List.FirstItem(list=getConnectors_2)
disConnectFrom = OpenMEP.ConnectorManager.Connector.DisConnectFrom(connector=getConnectors, connectorFrom=firstItem)
