# Dynamo graph Connector.Display.dyn (Dynamo 2.16.1.2727)
# packages: OpenMEP 1.0.0

select_pipe = DSModelElementSelection()  # 1 picked in the model
getConnectors = OpenMEP.ConnectorManager.Connector.GetConnectors(element=select_pipe)
integer_slider = IntegerSlider(1, range=0..1 step 1)
code_block = CodeBlock(a=getConnectors, n=integer_slider) { a[0..n]; }
display = OpenMEP.ConnectorManager.Connector.Display(connector=code_block)
geometry = Element.Geometry(element=select_pipe)
