# Dynamo graph Connector.GetConnectorFarthest.dyn (Dynamo 2.16.1.2727)
# packages: OpenMEP 1.0.0

select_model_element = DSModelElementSelection()  # 1 picked in the model
select_model_element_2 = DSModelElementSelection()  # 1 picked in the model
getConnectorFarthest = OpenMEP.ConnectorManager.Connector.GetConnectorFarthest(element1=select_model_element, element2=select_model_element_2)
