# Dynamo graph Connector.GetElementConnectedContinuous.dyn (Dynamo 2.16.1.2727)
# packages: OpenMEP 1.0.0

select_model_element = DSModelElementSelection()  # 1 picked in the model
getElementConnectedContinuous = OpenMEP.ConnectorManager.Connector.GetElementConnectedContinuous(element=select_model_element)
geometry = Element.Geometry(element=getElementConnectedContinuous)
