# Dynamo graph Connector.GetRemainingConnector.dyn (Dynamo 2.16.1.2727)
# packages: OpenMEP 1.0.0

select_model_element = DSModelElementSelection()  # 1 picked in the model
getConnectors = OpenMEP.ConnectorManager.Connector.GetConnectors(element=select_model_element)
code_block = CodeBlock(a=getConnectors) { a[0]; }
id = OpenMEP.ConnectorManager.Connector.Id(connector=code_block)
getRemainingConnector = OpenMEP.ConnectorManager.Connector.GetRemainingConnector(element=select_model_element, connector=code_block)
id_2 = OpenMEP.ConnectorManager.Connector.Id(connector=getRemainingConnector)
