# Dynamo graph Connector.IsConnectedTo.dyn (Dynamo 2.16.1.2727)
# packages: OpenMEP 1.0.0

select_model_element = DSModelElementSelection()  # 1 picked in the model
select_model_element_2 = DSModelElementSelection()  # 1 picked in the model
getConnectorClosest = OpenMEP.ConnectorManager.Connector.GetConnectorClosest(element1=select_model_element, element2=select_model_element_2)
getConnectorClosest_2 = OpenMEP.ConnectorManager.Connector.GetConnectorClosest(element1=select_model_element_2, element2=select_model_element)
isConnectedTo = OpenMEP.ConnectorManager.Connector.IsConnectedTo(connector=getConnectorClosest, connectorOther=getConnectorClosest_2)
