# Dynamo graph Connector.SetOrigin.dyn (Dynamo 2.16.1.2727)
# packages: OpenMEP 1.0.0

select_model_element = DSModelElementSelection()  # 1 picked in the model
getUnusedConnectors = OpenMEP.ConnectorManager.Connector.GetUnusedConnectors(element=select_model_element)
byCoordinates = Point.ByCoordinates()
setOrigin = OpenMEP.ConnectorManager.Connector.SetOrigin(connector=getUnusedConnectors, origin=byCoordinates)
