# Dynamo graph ConnectorManager.UnusedConnectors.dyn (Dynamo 2.16.1.2727)
# packages: OpenMEP 1.0.0

select_model_element = DSModelElementSelection()  # 1 picked in the model
getConnectorManager = OpenMEP.ConnectorManager.ConnectorManager.GetConnectorManager(element=select_model_element)
unusedConnectors = OpenMEP.ConnectorManager.ConnectorManager.UnusedConnectors(connectorManager=getConnectorManager)
