# Dynamo graph MEPModel.GetElectricalSystems.dyn (Dynamo 2.16.1.2727)
# packages: OpenMEP 1.0.0

select_model_element = DSModelElementSelection()  # 1 picked in the model
getMEPModel = OpenMEP.Element.FamilyInstance.GetMEPModel(familyInstance=select_model_element)
getElectricalSystems = OpenMEP.ConnectorManager.MEPModel.GetElectricalSystems(mepModel=getMEPModel)
