# Dynamo graph List.Intersect.dyn (Dynamo 2.17.2.4543)
# packages: OpenMEP 1.0.0

# group: Here's an example
# In this example, we've called the modified node with two lists of different types of objects, and the node has returned a new list containing the items that are common to both lists. The output shows the items that are common to list1 and list2.
code_block = CodeBlock { [1, "hello", true, 3.14]; }
code_block_2 = CodeBlock { ["hello", false, 3.14, 'a']; }
intersect = OpenMEPSandbox.Core.List.Intersect(list1=code_block, list2=code_block_2)
