# Dynamo graph String.IsMatch.dyn (Dynamo 2.17.2.4543)
# packages: OpenMEP 1.0.0

# group: Check if a string contains only numeric characters:
# In this example, the regular expression ^[0-9]+$ matches a string that contains only one or more numeric characters. The ^ and $ anchors ensure that the entire string is matched, rather than just a portion of it.
string = StringInput("12345")
string_2 = StringInput("^[0-9]+$")
isMatch = OpenMEPSandbox.Core.String.IsMatch(input=string, pattern=string_2)

# group: Check if a string contains a valid email address:
# In this example, the regular expression ^[^@\s]+@[^@\s]+\.[^@\s]+$ matches a string that contains a valid email address. The expression ensures that the string contains a single "@" symbol, followed by one or more characters before and after the "@" symbol, and then followed by a period and one or more characters.
string_3 = StringInput("example@example.com")
string_4 = StringInput("^[^@\s]+@[^@\s]+\.[^@\s]+$")
isMatch_2 = OpenMEPSandbox.Core.String.IsMatch(input=string_3, pattern=string_4)

# group: Check if a string contains a valid URL:
# In this example, the regular expression ^[^@\s]+@[^@\s]+\.[^@\s]+$ matches a string that contains a valid email address. The expression ensures that the string contains a single "@" symbol, followed by one or more characters before and after the "@" symbol, and then followed by a period and one or more characters.
string_5 = StringInput("https://www.example.com")
string_6 = StringInput("^https?://[\w-]+(\.[\w-]+)+([\w.,@?^=%&:/~+#-]*[\w@?^=%&/~+#-])?$")
isMatch_3 = OpenMEPSandbox.Core.String.IsMatch(input=string_5, pattern=string_6)
