# Dynamo graph FamilyDocument.FamilyManager.dyn (Dynamo 2.16.1.2727)
# packages: OpenMEP 1.0.0

select_model_element = DSModelElementSelection()  # 1 picked in the model
elementType = Element.ElementType(element=select_model_element)
family = FamilyType.Family(familyType=elementType)
editFamily = OpenMEP.Element.Family.Family.EditFamily(family=family)
familyManager = OpenMEP.Document.FamilyDocument.FamilyManager(doc=editFamily)
code_block = CodeBlock()  # // Select a family instance
