# Dynamo graph Selection.ZoomToLinkElement.dyn (Dynamo 2.18.1.5096)
# packages: Rhythm 2023.7.2, OpenMEP 1.0.0

select_elements_from_link = SelectElementsInLink()  # 1 picked in the model
boolean = BoolSelector(false)
zoomToLinkElement = OpenMEPRevit.Document.Selection.ZoomToLinkElement(elements=select_elements_from_link.Elements, isCropView=boolean)
