# Dynamo graph CableTray.CreateByLine.dyn (Dynamo 2.16.1.2727)
# packages: OpenMEP 1.0.0

element_classes = ElementTypes("CableTrayType")
all_elements_of_class = ElementsOfType(element_class=element_classes)
code_block = CodeBlock(a=all_elements_of_class) { a[0]; }
byCoordinates = Point.ByCoordinates()
code_block_2 = CodeBlock { 1000; }
byCoordinates_2 = Point.ByCoordinates(x=code_block_2)
byStartPointEndPoint = Line.ByStartPointEndPoint(startPoint=byCoordinates, endPoint=byCoordinates_2)
levels = Levels("Level 1")
code_block_3 = CodeBlock { 100; }
createByLine = OpenMEP.Element.CableTray.CreateByLine(cableTrayType=code_block, line=byStartPointEndPoint, level=levels, width=code_block_3)  # unwired: height
