# Dynamo graph CableTray.CreateByPoint.dyn (Dynamo 2.16.1.2727)
# packages: OpenMEP 1.0.0

element_classes = ElementTypes("CableTrayType")
all_elements_of_class = ElementsOfType(element_class=element_classes)
code_block = CodeBlock(a=all_elements_of_class) { a[0]; }
byCoordinates = Point.ByCoordinates()
code_block_2 = CodeBlock { 1000; }
byCoordinates_2 = Point.ByCoordinates(x=code_block_2)
levels = Levels("Level 1")
code_block_3 = CodeBlock { 100; }
createByTwoPoint = OpenMEP.Element.CableTray.CreateByTwoPoint(cableTrayType=code_block, startPoint=byCoordinates, endPoint=byCoordinates_2, level=levels, width=code_block_3, height=code_block_3)
