# Dynamo graph CableTray.CreateByPointAndDirection.dyn (Dynamo 2.16.1.2727)
# packages: OpenMEP 1.0.0

element_classes = ElementTypes("CableTrayType")
all_elements_of_class = ElementsOfType(element_class=element_classes)
code_block = CodeBlock(a=all_elements_of_class) { a[0]; }
byCoordinates = Point.ByCoordinates()
ZAxis = Vector.ZAxis()
code_block_2 = CodeBlock { 5000; }
levels = Levels("Level 1")
code_block_3 = CodeBlock { 100; }
createByPointAndDirection = OpenMEP.Element.CableTray.CreateByPointAndDirection(cableTrayType=code_block, startPoint=byCoordinates, direction=ZAxis, length=code_block_2, level=levels, width=code_block_3, height=code_block_3)
