# Dynamo graph Conduit.CreateByTwoConnectorDiameter.dyn (Dynamo 2.16.1.2727)
# packages: OpenMEP 1.0.0

element_classes = ElementTypes("ConduitType")
all_elements_of_class = ElementsOfType(element_class=element_classes)
firstItem = List.FirstItem(list=all_elements_of_class)
select_model_element = DSModelElementSelection()  # 1 picked in the model
getUnusedConnectors = OpenMEP.ConnectorManager.Connector.GetUnusedConnectors(element=select_model_element)
select_model_element_2 = DSModelElementSelection()  # 1 picked in the model
getUnusedConnectors_2 = OpenMEP.ConnectorManager.Connector.GetUnusedConnectors(element=select_model_element_2)
levels = Levels("Level 1")
code_block = CodeBlock { 300; }
createByTwoConnector = OpenMEP.Element.Conduit.CreateByTwoConnector(conduitType=firstItem, firstConnector=getUnusedConnectors, secondConnector=getUnusedConnectors_2, level=levels, diameter=code_block)
