# Dynamo graph Duct.CreateByConnectorAndPoint.dyn (Dynamo 2.16.1.2727)
# packages: OpenMEP 1.0.0

element_classes = ElementTypes("DuctType")
all_elements_of_class = ElementsOfType(element_class=element_classes)
firstItem = List.FirstItem(list=all_elements_of_class)
levels = Levels("Level 1")
select_model_element = DSModelElementSelection()  # 1 picked in the model
getUnusedConnectors = OpenMEP.ConnectorManager.Connector.GetUnusedConnectors(element=select_model_element)
select_model_element_2 = DSModelElementSelection()  # 1 picked in the model
getUnusedConnectors_2 = OpenMEP.ConnectorManager.Connector.GetUnusedConnectors(element=select_model_element_2)
origin = OpenMEP.ConnectorManager.Connector.Origin(connector=getUnusedConnectors_2)
createByConnectorAndPoint = OpenMEP.Element.Duct.CreateByConnectorAndPoint(ductType=firstItem, level=levels, startConnector=getUnusedConnectors, endPoint=origin)
