# Dynamo graph Duct.CreateByTwoConnectorSize.dyn (Dynamo 2.16.1.2727)
# packages: OpenMEP 1.0.0

element_classes = ElementTypes("DuctType")
all_elements_of_class = ElementsOfType(element_class=element_classes)
firstItem = List.FirstItem(list=all_elements_of_class)
levels = Levels("Level 1")
select_model_element = DSModelElementSelection()  # 1 picked in the model
getUnusedConnectors = OpenMEP.ConnectorManager.Connector.GetUnusedConnectors(element=select_model_element)
select_model_element_2 = DSModelElementSelection()  # 1 picked in the model
getUnusedConnectors_2 = OpenMEP.ConnectorManager.Connector.GetUnusedConnectors(element=select_model_element_2)
code_block = CodeBlock { 300; 200; }
createByTwoConnector = OpenMEP.Element.Duct.CreateByTwoConnector(ductType=firstItem, level=levels, startConnector=getUnusedConnectors, endConnector=getUnusedConnectors_2, width=code_block.out0, height=code_block.out1)
