# Dynamo graph Duct.CreatePlaceholderByTwoPointSize.dyn (Dynamo 2.16.1.2727)
# packages: OpenMEP 1.0.0

element_classes = ElementTypes("MechanicalSystemType")
all_elements_of_class = ElementsOfType(element_class=element_classes)
firstItem = List.FirstItem(list=all_elements_of_class)
element_classes_2 = ElementTypes("DuctType")
all_elements_of_class_2 = ElementsOfType(element_class=element_classes_2)
firstItem_2 = List.FirstItem(list=all_elements_of_class_2)
levels = Levels("Level 1")
select_model_element = DSModelElementSelection()  # 1 picked in the model
getUnusedConnectors = OpenMEP.ConnectorManager.Connector.GetUnusedConnectors(element=select_model_element)
origin = OpenMEP.ConnectorManager.Connector.Origin(connector=getUnusedConnectors)
select_model_element_2 = DSModelElementSelection()  # 1 picked in the model
getUnusedConnectors_2 = OpenMEP.ConnectorManager.Connector.GetUnusedConnectors(element=select_model_element_2)
origin_2 = OpenMEP.ConnectorManager.Connector.Origin(connector=getUnusedConnectors_2)
code_block = CodeBlock { 300; 200; }
createPlaceholderByTwoPoint = OpenMEP.Element.Duct.CreatePlaceholderByTwoPoint(systemType=firstItem, ductType=firstItem_2, level=levels, startPoint=origin, endPoint=origin_2, width=code_block.out0, height=code_block.out1)
