# Dynamo graph Duct.IsHvacSystemTypeId.dyn (Dynamo 2.16.1.2727)
# packages: OpenMEP 1.0.0

element_classes = ElementTypes("MechanicalSystemType")
all_elements_of_class = ElementsOfType(element_class=element_classes)
isHvacSystemTypeId = OpenMEP.Element.Duct.IsHvacSystemTypeId(systemType=all_elements_of_class)
