# Dynamo graph Duct.SetSystemType.dyn (Dynamo 2.16.1.2727)
# packages: OpenMEP 1.0.0

element_classes = ElementTypes("MechanicalSystemType")
all_elements_of_class = ElementsOfType(element_class=element_classes)
firstItem = List.FirstItem(list=all_elements_of_class)
element_classes_2 = ElementTypes("DuctType")
all_elements_of_class_2 = ElementsOfType(element_class=element_classes_2)
firstItem_2 = List.FirstItem(list=all_elements_of_class_2)
levels = Levels("Level 1")
select_model_element = DSModelElementSelection()  # 1 picked in the model
getUnusedConnectors = OpenMEP.ConnectorManager.Connector.GetUnusedConnectors(element=select_model_element)
origin = OpenMEP.ConnectorManager.Connector.Origin(connector=getUnusedConnectors)
select_model_element_2 = DSModelElementSelection()  # 1 picked in the model
getUnusedConnectors_2 = OpenMEP.ConnectorManager.Connector.GetUnusedConnectors(element=select_model_element_2)
origin_2 = OpenMEP.ConnectorManager.Connector.Origin(connector=getUnusedConnectors_2)
createByTwoPoint = OpenMEP.Element.Duct.CreateByTwoPoint(systemType=firstItem, ductType=firstItem_2, level=levels, startPoint=origin, endPoint=origin_2)
lastItem = List.LastItem(list=all_elements_of_class)
setSystemType = OpenMEP.Element.Duct.SetSystemType(duct=createByTwoPoint, systemType=lastItem)
