# Dynamo graph Element.GetLocationGridLine.dyn (Dynamo 2.19.3.6394)
# packages: OpenMEP 1.0.0

select_model_element = DSModelElementSelection()  # 1 picked in the model
getLocationGridLine = OpenMEPRevit.Element.Element.GetLocationGridLine(element=select_model_element)
list_create = List.Create(item0=getLocationGridLine.TopGrid, item1=getLocationGridLine.BottomGrid, item2=getLocationGridLine.LeftGrid, item3=getLocationGridLine.RightGrid)
name = Element.Name(element=list_create)
categories = Categories("OST_Grids")
all_elements_of_category = ElementsOfCategory(Category=categories)
getClosestGridLine = OpenMEPRevit.Element.Element.GetClosestGridLine(element=select_model_element, grids=all_elements_of_category)
code_block = CodeBlock(x=getClosestGridLine.RightGrids) { x.Name; }
code_block_2 = CodeBlock(x=getClosestGridLine.TopGrids) { x.Name; }
code_block_3 = CodeBlock(x=getClosestGridLine.BottomGrids) { x.Name; }
code_block_4 = CodeBlock(x=getClosestGridLine.LeftGrids) { x.Name; }
