# Dynamo graph Element.RotateByDirection.dyn (Dynamo 2.16.1.2727)
# packages: OpenMEP 1.0.0

select_model_element = DSModelElementSelection()  # 1 picked in the model
ZAxis = Vector.ZAxis()
code_block = CodeBlock { 90; }
rotate = OpenMEP.Element.Element.Rotate(element=select_model_element, Axis=ZAxis, angle=code_block)
