# Dynamo graph Element.RotateByLine.dyn (Dynamo 2.16.1.2727)
# packages: OpenMEP 1.0.0

select_model_element = DSModelElementSelection()  # 1 picked in the model
byCoordinates = Point.ByCoordinates()
code_block = CodeBlock { 100; }
byCoordinates_2 = Point.ByCoordinates(z=code_block)
byStartPointEndPoint = Line.ByStartPointEndPoint(startPoint=byCoordinates, endPoint=byCoordinates_2)
code_block_2 = CodeBlock { 90; }
rotate = OpenMEP.Element.Element.Rotate(element=select_model_element, Axis=byStartPointEndPoint, angle=code_block_2)
