# Dynamo graph Element.RotateMultiple.dyn (Dynamo 2.16.1.2727)
# packages: OpenMEP 1.0.0

select_model_elements = DSModelElementsSelection()  # 2 picked in the model
ZAxis = Vector.ZAxis()
count = List.Count(list=select_model_elements)
cycle = List.Cycle(list=ZAxis, amount=count)
code_block = CodeBlock { 90; }
cycle_2 = List.Cycle(list=code_block, amount=count)
rotateMultiple = OpenMEP.Element.Element.RotateMultiple(elements=select_model_elements, vectorAxis=cycle, angles=cycle_2)
