# Dynamo graph Element.RotateMultipleByLine.dyn (Dynamo 2.16.1.2727)
# packages: OpenMEP 1.0.0

select_model_elements = DSModelElementsSelection()  # 2 picked in the model
code_block = CodeBlock()
# ---------- code_block.designscript (3 lines) ----------
p1=Autodesk.Point.ByCoordinates(0,0,0);
p2=Autodesk.Point.ByCoordinates(0,10,0);
Autodesk.Line.ByStartPointEndPoint(p1,p2);
# ----------------------------------------
code_block_2 = CodeBlock { 90; }
rotateMultiple = OpenMEP.Element.Element.RotateMultiple(elements=select_model_elements, lineAxis=code_block.out2, angle=code_block_2)
