# Dynamo graph Fitting.NewTeeFitting.dyn (Dynamo 2.16.1.2727)
# packages: OpenMEP 1.0.0

select_model_element = DSModelElementSelection()  # 1 picked in the model
getUnusedConnectors = OpenMEP.ConnectorManager.Connector.GetUnusedConnectors(element=select_model_element)
select_model_element_2 = DSModelElementSelection()  # 1 picked in the model
getUnusedConnectors_2 = OpenMEP.ConnectorManager.Connector.GetUnusedConnectors(element=select_model_element_2)
select_model_element_3 = DSModelElementSelection()  # 1 picked in the model
getUnusedConnectors_3 = OpenMEP.ConnectorManager.Connector.GetUnusedConnectors(element=select_model_element_3)
newTeeFitting = OpenMEP.Element.Fitting.NewTeeFitting(connector1=getUnusedConnectors, connector2=getUnusedConnectors_2, connector3=getUnusedConnectors_3)
