# Dynamo graph Fitting.SetAngle.dyn (Dynamo 2.16.1.2727)
# packages: OpenMEP 1.0.0

select_model_element = DSModelElementSelection()  # 1 picked in the model
code_block = CodeBlock { 45; }
setAngle = OpenMEP.Element.Fitting.SetAngle(fitting=select_model_element, angle=code_block)
