# Dynamo graph Fitting.SetRadius.dyn (Dynamo 2.16.1.2727)
# packages: OpenMEP 1.0.0

select_model_element = DSModelElementSelection()  # 1 picked in the model
code_block = CodeBlock { 50; }
setRadius = OpenMEP.Element.Fitting.SetRadius(fitting=select_model_element, radius=code_block)
