# Dynamo graph MEPCurve.NewTeeFitting3.dyn "MEPCurve.NewTeeFitting" (Dynamo 2.16.1.2727)
# packages: OpenMEP 1.0.0

select_model_element = DSModelElementSelection()  # 1 picked in the model
select_model_element_2 = DSModelElementSelection()  # 1 picked in the model
select_model_element_3 = DSModelElementSelection()  # 1 picked in the model
newTeeFitting = OpenMEP.Element.MEPCurve.NewTeeFitting(mepCurve1=select_model_element, mepCurve2=select_model_element_2, mepCurve3=select_model_element_3)
