# Dynamo graph MEPCurveType.MultiShapeTransition.dyn (Dynamo 2.16.1.2727)
# packages: OpenMEP 1.0.0

select_model_element = DSModelElementSelection()  # 1 picked in the model
elementType = Element.ElementType(element=select_model_element)
multiShapeTransition = OpenMEP.Element.MEPCurveType.MultiShapeTransition(mepcurvetype=elementType)
