# Dynamo graph Pipe.CreateByPointDirection.dyn (Dynamo 2.16.1.2727)
# packages: OpenMEP 1.0.0

element_classes = ElementTypes("PipingSystemType")
all_elements_of_class = ElementsOfType(element_class=element_classes)
firstItem = List.FirstItem(list=all_elements_of_class)
element_classes_2 = ElementTypes("PipeType")
all_elements_of_class_2 = ElementsOfType(element_class=element_classes_2)
firstItem_2 = List.FirstItem(list=all_elements_of_class_2)
levels = Levels("Level 1")
byCoordinates = Point.ByCoordinates()
ZAxis = Vector.ZAxis()
code_block = CodeBlock { 100; }
createByPointAndDirection = OpenMEP.Element.Pipe.CreateByPointAndDirection(systemType=firstItem, pipeType=firstItem_2, level=levels, startPoint=byCoordinates, direction=ZAxis, length=code_block, diameter=code_block)
getLocation = Element.GetLocation(element=createByPointAndDirection)
