# Dynamo graph Pipe.SetDiameter.dyn (Dynamo 2.16.1.2727)
# packages: OpenMEP 1.0.0

select_model_element = DSModelElementSelection()  # 1 picked in the model
code_block = CodeBlock { 100; }
setDiameter = OpenMEP.Element.Pipe.SetDiameter(pipe=select_model_element, diameter=code_block)
