# Dynamo graph View.GetAllElementByViewFilter.dyn (Dynamo 2.17.0.3472)
# packages: OpenMEP 1.0.0

boolean = BoolSelector(false)
getAllViewFilters = OpenMEP.Element.View.GetAllViewFilters(flag=boolean)
code_block = CodeBlock(a=getAllViewFilters) { a[42]; }
getAllElementByViewFilter = OpenMEP.Element.View.GetAllElementByViewFilter(viewFilter=code_block)
code_block_2 = CodeBlock(x=getAllViewFilters) { x.Name; }
