# Dynamo graph View.GetAllViewFilters.dyn (Dynamo 2.17.0.3472)
# packages: OpenMEP 1.0.0

boolean = BoolSelector(false)
getAllViewFilters = OpenMEP.Element.View.GetAllViewFilters(flag=boolean)
name = Element.Name(element=getAllViewFilters)
