# Dynamo graph Curve.SplitBySegmentsLengths.dyn (Dynamo 2.18.0.2986)
# packages: OpenMEP 1.0.0

code_block = CodeBlock { Autodesk.Point.ByCoordinates(0,0,0); Autodesk.Point.ByCoordinates(100,0,0); }
byStartPointEndPoint = Line.ByStartPointEndPoint(startPoint=code_block.out0, endPoint=code_block.out1)
code_block_2 = CodeBlock { [20,30]; }
splitBySegmentsLengths = OpenMEPSandbox.Geometry.Curve.SplitBySegmentsLengths(curve=byStartPointEndPoint, segmentLengths=code_block_2)
