# Dynamo graph Point.AsPoint.dyn (Dynamo 2.18.0.4470)
# packages: OpenMEP 1.0.0

code_block = CodeBlock { "[-0.5,-9.5,+1.8]"; }
asPoint = OpenMEPSandbox.Geometry.Point.AsPoint(str=code_block)
code_block_2 = CodeBlock { "(0.5-9.5-1.8)"; }
code_block_3 = CodeBlock { "(5-9-8)"; }
code_block_4 = CodeBlock { "(5-9-8)"; }
code_block_5 = CodeBlock { "(37,11,2)"; }
code_block_6 = CodeBlock { "(0.5,9.5)"; }
code_block_7 = CodeBlock { "(0.5-9.5)"; }
code_block_8 = CodeBlock { "(0-9)"; }
code_block_9 = CodeBlock()
# ---------- code_block_9.designscript (3 lines) ----------
"[
  Point(X = 10.000, Y = 10.000, Z = 10.000)
]";
# ----------------------------------------
code_block_10 = CodeBlock { "Point(X = 10.000, Y = 10.000, Z = 10.000)"; }
code_block_11 = CodeBlock { "(X = 10.000, Y = 10.000, Z = 10.000)"; }
code_block_12 = CodeBlock { "X = 10.000, Y = 10.000, Z = 10.000"; }
code_block_13 = CodeBlock { "Point(X = 10.000, Y = 10.000)"; }
code_block_14 = CodeBlock { "(X = 10.000, Y = 10.000)"; }
code_block_15 = CodeBlock { "X = 10.000, Y = 10.000"; }
code_block_16 = CodeBlock { "0.5,9.5,1.8"; }
code_block_17 = CodeBlock { "0.5,9.5"; }
code_block_18 = CodeBlock { "[-0.5,-9.5,-1.8]"; }
