# Dynamo graph Point.GenerateRandomPointInCircle.dyn (Dynamo 2.18.0.2986)
# packages: OpenMEP 1.0.0

code_block = CodeBlock { 10; }
ZAxis = Vector.ZAxis()
byCenterPointRadiusNormal = Circle.ByCenterPointRadiusNormal(radius=code_block, normal=ZAxis)
integer_slider = IntegerSlider(450, range=0..1000 step 50)
generateRandomPointInCircle = OpenMEPSandbox.Geometry.Point.GenerateRandomPointInCircle(circle=byCenterPointRadiusNormal, numPoints=integer_slider)
