# Dynamo graph Point.GenerateRandomPointsOnCircle.dyn (Dynamo 2.18.0.2986)
# packages: OpenMEP 1.0.0

integer_slider = IntegerSlider(20, range=0..100 step 1)
byCenterPointRadiusNormal = Circle.ByCenterPointRadiusNormal(radius=integer_slider)
integer_slider_2 = IntegerSlider(91, range=0..100 step 1)
generateRandomPointsOnCircle = OpenMEPSandbox.Geometry.Point.GenerateRandomPointsOnCircle(circle=byCenterPointRadiusNormal, numPoints=integer_slider_2)
