# Dynamo graph Point.IsInPolygonPlus.dyn (Dynamo 2.17.3.4871)
# packages: OpenMEP 1.0.0

number_slider = DoubleSlider(8.9, range=0..100 step 0.1)
byCoordinates = Point.ByCoordinates(x=number_slider)
code_block = CodeBlock { 10; }
byCenterPointRadius = Circle.ByCenterPointRadius(radius=code_block)
regularPolygon = Polygon.RegularPolygon(circle=byCenterPointRadius)
isInPolygonPlus = OpenMEPSandbox.Geometry.Point.IsInPolygonPlus(point=byCoordinates, polygon=regularPolygon)
