# Dynamo graph Point.IsOnPlane.dyn (Dynamo 2.16.1.2727)
# packages: OpenMEP 1.0.0

number_slider = DoubleSlider(0, range=0..100 step 0.1)
byCoordinates = Point.ByCoordinates(x=number_slider)
XAxis = Vector.XAxis()
byOriginNormal = Plane.ByOriginNormal(normal=XAxis)
isOnPlane = OpenMEP.Geometry.Point.IsOnPlane(point=byCoordinates, plane=byOriginNormal)
