# Dynamo graph Point.Reflect.dyn (Dynamo 2.18.0.2986)
# packages: OpenMEP 1.0.0

number_slider = DoubleSlider(4.6, range=0..100 step 0.1)
code_block = CodeBlock { 1..10; }
byCoordinates = Point.ByCoordinates(x=number_slider, y=code_block)
YAxis = Vector.YAxis()
byOriginNormal = Plane.ByOriginNormal(normal=YAxis)
reflect = OpenMEPSandbox.Geometry.Point.Reflect(point=byCoordinates, plane=byOriginNormal)
