# Dynamo graph Vector.Display.dyn (Dynamo 2.16.1.2727)
# packages: OpenMEP 1.0.0

ZAxis = Vector.ZAxis()
origin = OpenMEPSandbox.Geometry.Point.Origin()
number_slider = DoubleSlider(0, range=0..100 step 2)
display = OpenMEPSandbox.Geometry.Vector.Display(vector=ZAxis, startPoint=origin, scale=number_slider)
YAxis = Vector.YAxis()
