# Dynamo graph Vector.Floor.dyn (Dynamo 2.17.2.4543)
# packages: OpenMEP 1.0.0

code_block = CodeBlock { 3.6; }
byCoordinates = Vector.ByCoordinates(x=code_block, y=code_block, z=code_block)
floor = OpenMEPSandbox.Geometry.Vector.Floor(vector=byCoordinates)
