# Dynamo graph Vector.IsPerpendicular.dyn (Dynamo 2.18.0.2986)
# packages: OpenMEP 1.0.0

ZAxis = Vector.ZAxis()
YAxis = Vector.YAxis()
isPerpendicular = OpenMEPSandbox.Geometry.Vector.IsPerpendicular(v1=ZAxis, v2=YAxis)
list_create = List.Create(item0=ZAxis, item1=YAxis)
byCoordinates = Point.ByCoordinates()
display = OpenMEPSandbox.Geometry.Vector.Display(vector=list_create, startPoint=byCoordinates)
