# Dynamo graph GraphVisualizer.VisualizeByDestination.dyn (Dynamo 2.17.2.4543)
# packages: OpenMEP 1.0.0

byCoordinates = Point.ByCoordinates()
code_block = CodeBlock { 100; }
byCoordinates_2 = Point.ByCoordinates(y=code_block)
list_create = List.Create(item0=byCoordinates, item1=byCoordinates_2)
code_block_2 = CodeBlock { 100; }
byCoordinates_3 = Point.ByCoordinates(y=code_block_2)
code_block_3 = CodeBlock { 300; }
byCoordinates_4 = Point.ByCoordinates(x=code_block_3, y=code_block_3)
list_create_2 = List.Create(item0=byCoordinates_3, item1=byCoordinates_4)
visualizeByDestination = OpenMEPSandbox.Graph.GraphVisualizer.VisualizeByDestination(source=list_create, destination=list_create_2)
