# Dynamo graph Matrix.BuildAdjMatrixByGraph.dyn (Dynamo 2.17.2.4543)
# packages: OpenMEP 1.0.0

code_block = CodeBlock()
# ---------- code_block.designscript (7 lines) ----------
startNode =0;
// source and destinations
// same with lst1 and lst2
[0,0,1,1,1,2,3,3];
[1,3,2,3,4,1,2,4];
//Distance
[6,7,5,8,1,1,1,13,9];
# ----------------------------------------
buildAdjMatrixByGraph = OpenMEPSandbox.Graph.Matrix.BuildAdjMatrixByGraph(sources=code_block.out1, destinations=code_block.out2, weights=code_block.out3)
