# Dynamo graph Path.FindShortestPathDijkstra.dyn (Dynamo 2.17.2.4543)
# packages: OpenMEP 1.0.0

code_block = CodeBlock { [0,0,100,100,100,200,300,300]; [100,300,200,300,400,100,200,400]; }
indexUniqueTwoListObjects = OpenMEPSandbox.List.Generate.IndexUniqueTwoListObjects(list1=code_block.out0, list2=code_block.out1)
code_block_2 = CodeBlock()
# ---------- code_block_2.designscript (7 lines) ----------
startNode =0;
// source and destinations
// same with lst1 and lst2
[0,0,1,1,1,2,3,3];
[1,3,2,3,4,1,2,4];
//Distance
[6,7,5,8,1,1,1,13,9];
# ----------------------------------------
endNode = IntegerSlider(3, range=0..4 step 1)
indexTwoListObjects = OpenMEPSandbox.List.Generate.IndexTwoListObjects(lst1=code_block.out0, lst2=code_block.out1)
findShortestPathDijkstra = OpenMEPSandbox.Graph.Path.FindShortestPathDijkstra(startNode=code_block_2.startNode, endNode=endNode, sources=indexTwoListObjects.lst1, destinations=indexTwoListObjects.lst2, weights=code_block_2.out3)
getItemAtIndex = List.GetItemAtIndex(list=indexUniqueTwoListObjects.name, index=findShortestPathDijkstra.shortestPath)
