# Dynamo graph Database.SnoopElements.dyn (Dynamo 2.16.1.2727)
# packages: OpenMEP 1.0.0

select_model_element = DSModelElementSelection()  # 1 picked in the model
snoopElements = OpenMEP.Application.Database.SnoopElements(elements=select_model_element)
select_model_elements = DSModelElementsSelection()  # nothing selected
