# Dynamo graph Application.OpenDocument.dyn (Dynamo 2.16.1.2727)
# packages: OpenMEP 1.0.0

boolean = BoolSelector(true)
current = OpenMEPSandbox.Autocad.Application.Current(toggle=boolean)
string = StringInput("Your Path")
openDocument = OpenMEPSandbox.Autocad.Application.OpenDocument(AcadApplication=current, filePath=string)
