# Dynamo graph BlockReference.GetDynamicBlockProperties.dyn (Dynamo 2.17.2.4543)
# packages: OpenMEP 1.0.0

boolean = BoolSelector(false)
current = OpenMEPSandbox.Autocad.Document.Current(toggle=boolean)
blockReferences = OpenMEPSandbox.Autocad.Document.BlockReferences(IAcadDocument=current)
isDynamicBlock = OpenMEPSandbox.Autocad.BlockReference.IsDynamicBlock(AcadBlockReference=blockReferences)
code_block = CodeBlock(a=blockReferences) { a[7]; }
getDynamicBlockProperties = OpenMEPSandbox.Autocad.BlockReference.GetDynamicBlockProperties(AcadBlockReference=code_block)
code_block_2 = CodeBlock(x=getDynamicBlockProperties.names) { x; }
