# Dynamo graph BlockReference.ResetBlock.dyn (Dynamo 2.19.0.5224)
# packages: OpenMEP 1.0.0

boolean = BoolSelector(true)
current = OpenMEPCad.Autocad.Document.Current(toggle=boolean)
database = OpenMEPCad.Autocad.Document.Database(AcadDocument=current)
blockReferences = OpenMEPCad.Autocad.Database.BlockReferences(AcadDatabase=database)
name = OpenMEPCad.Autocad.BlockReference.Name(AcadBlockReference=blockReferences)
resetBlock = OpenMEPCad.Autocad.BlockReference.ResetBlock(AcadBlockReference=blockReferences)
name_2 = OpenMEPCad.Autocad.BlockReference.Name(AcadBlockReference=resetBlock)
