# Dynamo graph Database.BlockReferences.dyn (Dynamo 2.18.1.5092)
# packages: OpenMEP 1.0.0

boolean = BoolSelector(true)
current = OpenMEPSandbox.Autocad.Document.Current(toggle=boolean)
database = OpenMEPSandbox.Autocad.Document.Database(AcadDocument=current)
blockReferences = OpenMEPSandbox.Autocad.Database.BlockReferences(AcadDatabase=database)
