# Dynamo graph Database.Blocks.dyn (Dynamo 2.18.1.5092)
# packages: OpenMEP 1.0.0

boolean = BoolSelector(false)
current = OpenMEPSandbox.Autocad.Document.Current(toggle=boolean)
database = OpenMEPSandbox.Autocad.Document.Database(AcadDocument=current)
blocks = OpenMEPSandbox.Autocad.Database.Blocks(AcadDatabase=database)
