# Dynamo graph Document.FullName.dyn (Dynamo 2.18.1.5092)
# packages: OpenMEP 1.0.0

boolean = BoolSelector(true)
current = OpenMEPSandbox.Autocad.Document.Current(toggle=boolean)
fullName = OpenMEPSandbox.Autocad.Document.FullName(AcadDocument=current)
