# Dynamo graph Object.GetMethods.dyn (Dynamo 2.18.1.5092)
# packages: OpenMEP 1.0.0

boolean = BoolSelector(true)
current = OpenMEPSandbox.Autocad.Document.Current(toggle=boolean)
cadFilterTypes = CadFilterDropDown("Point")
getCadObjectsByFilters = OpenMEPSandbox.Autocad.Document.GetCadObjectsByFilters(AcadDocument=current, CadFilterType=cadFilterTypes)
getMethods = OpenMEPSandbox.Autocad.Object.GetMethods(Object=getCadObjectsByFilters)
