# Dynamo graph Connector.AssignedFixtureUnits.dyn (Dynamo 2.16.1.2727)
# packages: OpenMEP 1.0.0

select_model_element = DSModelElementSelection()  # 1 picked in the model
getConnectors = OpenMEP.ConnectorManager.Connector.GetConnectors(element=select_model_element)
assignedFixtureUnits = OpenMEP.ConnectorManager.Connector.AssignedFixtureUnits(connector=getConnectors)
