# Dynamo graph Connector.CoordinateSystem.dyn (Dynamo 2.16.1.2727)
# packages: OpenMEP 1.0.0, Exyte 1.0.1

select_model_element = DSModelElementSelection()  # 1 picked in the model
getConnectors = OpenMEP.ConnectorManager.Connector.GetConnectors(element=select_model_element)
coordinateSystem = Exyte.Revit.MEPModel.Connector.CoordinateSystem(connector=getConnectors)
