# Dynamo graph Connector.Display.dyn (Dynamo 2.16.1.2727)
# packages: Exyte 1.0.1, OpenMEP 1.0.0

select_model_element = DSModelElementSelection()  # 1 picked in the model
geometry = Element.Geometry(element=select_model_element)
getConnectors = Exyte.Revit.MEPModel.Connector.GetConnectors(element=select_model_element)
code_block = CodeBlock(a=getConnectors) { a[1]; }
code_block_2 = CodeBlock { 1000; }
display = OpenMEP.ConnectorManager.Connector.Display(connector=code_block, length=code_block_2)
code_block_3 = CodeBlock(x=display.XYPlane) { x; }
