# Dynamo graph Connector.GetConnectorClosest.dyn (Dynamo 2.16.1.2727)
# packages: OpenMEP 1.0.0

select_model_element = DSModelElementSelection()  # 1 picked in the model
select_model_element_2 = DSModelElementSelection()  # 1 picked in the model
getConnectorClosest = OpenMEP.ConnectorManager.Connector.GetConnectorClosest(element1=select_model_element, element2=select_model_element_2)
