# Dynamo graph Connector.SetAngle.dyn (Dynamo 2.16.1.2727)
# packages: OpenMEP 1.0.0

select_model_element = DSModelElementSelection()  # 1 picked in the model
getConnectors = OpenMEP.ConnectorManager.Connector.GetConnectors(element=select_model_element)
firstItem = List.FirstItem(list=getConnectors)
code_block = CodeBlock { 30; }
setAngle = OpenMEP.ConnectorManager.Connector.SetAngle(connector=firstItem, angle=code_block)
