# Dynamo graph ConnectorManager.LookUp.dyn (Dynamo 2.16.1.2727)
# packages: Exyte 1.0.1

select_model_element = DSModelElementSelection()  # 1 picked in the model
getConnectorManager = Exyte.Revit.MEPModel.ConnectorManager.GetConnectorManager(element=select_model_element)
code_block = CodeBlock { 0; }
lookUp = Exyte.Revit.MEPModel.ConnectorManager.LookUp(connectorManager=getConnectorManager, index=code_block)
