# Dynamo graph ConnectorManager.UnusedConnectors.dyn (Dynamo 2.16.1.2727)
# packages: Exyte 1.0.1

select_model_element = DSModelElementSelection()  # 1 picked in the model
getConnectorManager = Exyte.Revit.MEPModel.ConnectorManager.GetConnectorManager(element=select_model_element)
unusedConnectors = Exyte.Revit.MEPModel.ConnectorManager.UnusedConnectors(connectorManager=getConnectorManager)
