# Dynamo graph MEPConnectorInfo.LinkedConnector.dyn (Dynamo 2.16.1.2727)
# packages: OpenMEP 1.0.0

select_model_element = DSModelElementSelection()  # 1 picked in the model
getConnectors = OpenMEP.ConnectorManager.Connector.GetConnectors(element=select_model_element)
getMEPConnectorInfo = OpenMEP.ConnectorManager.Connector.GetMEPConnectorInfo(connector=getConnectors)
linkedConnector = OpenMEP.ConnectorManager.MEPConnectorInfo.LinkedConnector(mepConnectorInfo=getMEPConnectorInfo)
