# Dynamo graph List.IndexObjects.dyn (Dynamo 2.17.2.4543)
# packages: OpenMEP 1.0.0

code_block = CodeBlock { [100,200,300,200,100,300]; }
indexObjects = OpenMEPSandbox.Core.List.IndexObjects(objects=code_block)
code_block_2 = CodeBlock { ["Red","Green","Blue","Green"]; }
indexObjects_2 = OpenMEPSandbox.Core.List.IndexObjects(objects=code_block_2)
