# Dynamo graph List.IndexUniqueObjects.dyn (Dynamo 2.17.2.4543)
# packages: OpenMEP 1.0.0

code_block = CodeBlock { [100,200,300,100]; }
indexUniqueObjects = OpenMEPSandbox.Core.List.IndexUniqueObjects(lst=code_block)
code_block_2 = CodeBlock { ["Red","Green","Blue","Red"]; }
indexUniqueObjects_2 = OpenMEPSandbox.Core.List.IndexUniqueObjects(lst=code_block_2)
