# Dynamo graph String.BestSimilarityScore.dyn (Dynamo 2.17.3.4871)
# packages: OpenMEP 1.0.0

code_block = CodeBlock { a = "Hello"; b = ["Hello A","Hello ","Hello B"]; }
code_block_2 = CodeBlock { 0.8; }
bestSimilarityScore = OpenMEPSandbox.Core.String.BestSimilarityScore(string=code_block.a, listString=code_block.b, threshold=code_block_2)
