# Dynamo graph String.SimilarityScore.dyn (Dynamo 2.17.3.4871)
# packages: OpenMEP 1.0.0

code_block = CodeBlock { "Hello World"; }
code_block_2 = CodeBlock { "Hello World 1"; }
similarityScore = OpenMEPSandbox.Core.String.SimilarityScore(str1=code_block, str2=code_block_2)
