# Dynamo graph Selection.SetSelectedElement.dyn (Dynamo 2.17.0.3472)
# packages: OpenMEP 1.0.0

select_model_elements = DSModelElementsSelection()  # 8 picked in the model
setSelectedElement = OpenMEP.Document.Selection.SetSelectedElement(elements=select_model_elements)
select_model_element = DSModelElementSelection()  # 1 picked in the model
