# Dynamo graph Connector.Domain.dyn (Dynamo 2.16.1.2727)
# packages: OpenMEP 1.0.0

select_model_element = DSModelElementSelection()  # nothing selected
getConnectors = OpenMEP.ConnectorManager.Connector.GetConnectors(element=select_model_element)
domain = OpenMEP.ConnectorManager.Connector.Domain(connector=getConnectors)
