# Dynamo graph Connector.GetElementConnectedWith.dyn (Dynamo 2.16.1.2727)
# packages: OpenMEP 1.0.0

select_model_element = DSModelElementSelection()  # nothing selected
getUnusedConnectors = OpenMEP.ConnectorManager.Connector.GetUnusedConnectors(element=select_model_element)
getElementConnectedWith = OpenMEP.ConnectorManager.Connector.GetElementConnectedWith(connector=getUnusedConnectors)
