# Dynamo graph ConnectorManager.Connectors.dyn (Dynamo 2.16.1.2727)
# packages: Exyte 1.0.1

select_model_element = DSModelElementSelection()  # 1 picked in the model
getConnectorManager = Exyte.Revit.MEPModel.ConnectorManager.GetConnectorManager(element=select_model_element)
connectors = Exyte.Revit.MEPModel.ConnectorManager.Connectors(connectorManager=getConnectorManager)
