# Dynamo graph Fitting.NewCrossFitting.dyn (Dynamo 2.16.1.2727)
# packages: OpenMEP 1.0.0

select_model_element = DSModelElementSelection()  # 1 picked in the model
select_model_element_2 = DSModelElementSelection()  # 1 picked in the model
select_model_element_3 = DSModelElementSelection()  # 1 picked in the model
select_model_element_4 = DSModelElementSelection()  # 1 picked in the model
getFourConnectorsClosest = OpenMEP.Element.MEPCurve.GetFourConnectorsClosest(mepCurve1=select_model_element, mepCurve2=select_model_element_2, mepCurve3=select_model_element_3, mepCurve4=select_model_element_4)
newCrossFitting = OpenMEP.Element.Fitting.NewCrossFitting(c1=getFourConnectorsClosest.Connector1, c2=getFourConnectorsClosest.Connector2, c3=getFourConnectorsClosest.Connector3, c4=getFourConnectorsClosest.Connector4)
