# Dynamo graph MEPCurve.GetFourConnectorsClosest.dyn (Dynamo 2.16.1.2727)
# packages: OpenMEP 1.0.0, Exyte 1.0.1

select_model_element = DSModelElementSelection()  # 1 picked in the model
select_model_element_2 = DSModelElementSelection()  # 1 picked in the model
select_model_element_3 = DSModelElementSelection()  # 1 picked in the model
select_model_element_4 = DSModelElementSelection()  # 1 picked in the model
getFourConnectorsClosest = OpenMEP.Element.MEPCurve.GetFourConnectorsClosest(mepCurve1=select_model_element, mepCurve2=select_model_element_2, mepCurve3=select_model_element_3, mepCurve4=select_model_element_4)
list_create = List.Create(item0=getFourConnectorsClosest.Connector1, item1=getFourConnectorsClosest.Connector2, item2=getFourConnectorsClosest.Connector3, item3=getFourConnectorsClosest.Connector4)
origin = Exyte.Revit.MEPModel.Connector.Origin(connector=list_create)
code_block = CodeBlock { 5; }
byCenterPointRadius = Circle.ByCenterPointRadius(centerPoint=origin, radius=code_block)
