# Dynamo graph Conduit.CreateByLineDiameter.dyn (Dynamo 2.16.1.2727)
# packages: OpenMEP 1.0.0

element_classes = ElementTypes("ConduitType")
all_elements_of_class = ElementsOfType(element_class=element_classes)
firstItem = List.FirstItem(list=all_elements_of_class)
byCoordinates = Point.ByCoordinates()
code_block = CodeBlock { 100; }
byCoordinates_2 = Point.ByCoordinates(y=code_block)
byStartPointEndPoint = Line.ByStartPointEndPoint(startPoint=byCoordinates, endPoint=byCoordinates_2)
levels = Levels("Level 1")
code_block_2 = CodeBlock { 300; }
createByLine = OpenMEP.Element.Conduit.CreateByLine(conduitType=firstItem, line=byStartPointEndPoint, level=levels, diameter=code_block_2)
