# Dynamo graph Conduit.SetDiameter.dyn (Dynamo 2.16.1.2727)
# packages: OpenMEP 1.0.0

element_classes = ElementTypes("ConduitType")
all_elements_of_class = ElementsOfType(element_class=element_classes)
firstItem = List.FirstItem(list=all_elements_of_class)
byCoordinates = Point.ByCoordinates()
code_block = CodeBlock { 100; }
byCoordinates_2 = Point.ByCoordinates(y=code_block)
levels = Levels("Level 1")
createByTwoPoint = OpenMEP.Element.Conduit.CreateByTwoPoint(conduitType=firstItem, startPoint=byCoordinates, endPoint=byCoordinates_2, level=levels)
code_block_2 = CodeBlock { 300; }
setDiameter = OpenMEP.Element.Conduit.SetDiameter(conduit=createByTwoPoint, diameter=code_block_2)
