# Dynamo graph Element.MoveElement.dyn (Dynamo 2.16.1.2727)
# packages: OpenMEP 1.0.0

select_model_element = DSModelElementSelection()  # 1 picked in the model
byCoordinates = Point.ByCoordinates()
moveElement = OpenMEP.Element.Element.MoveElement(element=select_model_element, newLocation=byCoordinates)
