# Dynamo graph Element.MoveElements.dyn (Dynamo 2.16.1.2727)
# packages: OpenMEP 1.0.0

select_model_elements = DSModelElementsSelection()  # 2 picked in the model
moveElements = OpenMEP.Element.Element.MoveElements(elements=select_model_elements)  # unwired: newLocation
code_block = CodeBlock { 90; }
byCoordinates = Point.ByCoordinates(y=code_block)
