# Dynamo graph Element.RotateMultiple.dyn (Dynamo 2.16.1.2727)
# packages: OpenMEP 1.0.0

select_model_elements = DSModelElementsSelection()  # 2 picked in the model
ZAxis = Vector.ZAxis()
code_block = CodeBlock { 90; }
rotateMultiple = OpenMEP.Element.Element.RotateMultiple(elements=select_model_elements, vectorAxis=ZAxis, angle=code_block)
