# Dynamo graph FlexDuct.NewFlexDuctByTwoConnector.dyn (Dynamo 2.16.1.2727)
# packages: OpenMEP 1.0.0

select_model_element = DSModelElementSelection()  # 1 picked in the model
getUnusedConnectors = OpenMEP.ConnectorManager.Connector.GetUnusedConnectors(element=select_model_element)
select_model_element_2 = DSModelElementSelection()  # 1 picked in the model
getUnusedConnectors_2 = OpenMEP.ConnectorManager.Connector.GetUnusedConnectors(element=select_model_element_2)
element_classes = ElementTypes("DuctType")
all_elements_of_class = ElementsOfType(element_class=element_classes)
firstItem = List.FirstItem(list=all_elements_of_class)
newFlexDuct = OpenMEP.Element.FlexDuct.NewFlexDuct(connector1=getUnusedConnectors, connector2=getUnusedConnectors_2, ductType=firstItem)
