# Dynamo graph FlexPipe.NewFlexPipeByTwoConnector.dyn (Dynamo 2.16.1.2727)
# packages: OpenMEP 1.0.0

select_model_element = DSModelElementSelection()  # 1 picked in the model
getUnusedConnectors = OpenMEP.ConnectorManager.Connector.GetUnusedConnectors(element=select_model_element)
newFlexPipe = OpenMEP.Element.FlexPipe.NewFlexPipe(connector=getUnusedConnectors)  # unwired: connector2, pipeType
