# Dynamo graph FlexPipe.Points.dyn (Dynamo 2.16.1.2727)
# packages: OpenMEP 1.0.0

select_model_element = DSModelElementSelection()  # 1 picked in the model
getUnusedConnectors = OpenMEP.ConnectorManager.Connector.GetUnusedConnectors(element=select_model_element)
origin = OpenMEP.ConnectorManager.Connector.Origin(connector=getUnusedConnectors)
select_model_element_2 = DSModelElementSelection()  # 1 picked in the model
getUnusedConnectors_2 = OpenMEP.ConnectorManager.Connector.GetUnusedConnectors(element=select_model_element_2)
origin_2 = OpenMEP.ConnectorManager.Connector.Origin(connector=getUnusedConnectors_2)
list_create = List.Create(item0=origin, item1=origin_2)
flatten = List.Flatten(list=list_create)
element_classes = ElementTypes("PipeType")
all_elements_of_class = ElementsOfType(element_class=element_classes)
firstItem = List.FirstItem(list=all_elements_of_class)
newFlexPipe = OpenMEP.Element.FlexPipe.NewFlexPipe(points=flatten, pipeType=firstItem)
points = OpenMEP.Element.FlexPipe.Points(flexPipe=newFlexPipe)
