# Dynamo graph Insulation.IsAddInsulationOrLining.dyn (Dynamo 2.16.1.2727)
# packages: OpenMEP 1.0.0

select_model_element = DSModelElementSelection()  # 1 picked in the model
getInsulation = OpenMEP.Element.Insulation.GetInsulation(element=select_model_element)
hostElement = OpenMEP.Element.Insulation.HostElement(element=getInsulation)
isAddInsulationOrLining = OpenMEP.Element.Insulation.IsAddInsulationOrLining(insulation=getInsulation, element=hostElement)
