# Dynamo graph MEPCurve.BreakCurve.dyn (Dynamo 2.16.1.2727)
# packages: OpenMEP 1.0.0

select_model_element = DSModelElementSelection()  # 1 picked in the model
getLocation = Element.GetLocation(element=select_model_element)
code_block = CodeBlock { 0.5; }
pointAtParameter = Curve.PointAtParameter(curve=getLocation, param=code_block)
breakCurve = OpenMEP.Element.MEPCurve.BreakCurve(mepCurve=select_model_element, point=pointAtParameter)
