# Dynamo graph MEPCurve.NewTeeFitting.dyn (Dynamo 2.16.1.2727)
# packages: OpenMEP 1.0.0

select_model_element = DSModelElementSelection()  # 1 picked in the model
select_model_element_2 = DSModelElementSelection()  # 1 picked in the model
newTeeFitting = OpenMEP.Element.MEPCurve.NewTeeFitting(MepCurve1=select_model_element, MepCurve2=select_model_element_2)
