# Dynamo graph MEPCurve.NewTransitionFitting.dyn (Dynamo 2.16.1.2727)
# packages: OpenMEP 1.0.0

select_model_element = DSModelElementSelection()  # 1 picked in the model
select_model_element_2 = DSModelElementSelection()  # 1 picked in the model
newTransitionFitting = OpenMEP.Element.MEPCurve.NewTransitionFitting(mepCurve1=select_model_element, mepCurve2=select_model_element_2)
