# Dynamo graph MEPCurve.Slope.dyn (Dynamo 2.16.1.2727)
# packages: OpenMEP 1.0.0

select_model_element = DSModelElementSelection()  # 1 picked in the model
code_block = CodeBlock { 3; }
slope = OpenMEP.Element.MEPCurve.Slope(mepCurve=select_model_element, digit=code_block)
