# Dynamo graph MEPSystem.Elements.dyn (Dynamo 2.16.1.2727)
# packages: OpenMEP 1.0.0

select_model_element = DSModelElementSelection()  # 1 picked in the model
system = OpenMEP.Element.Element.System(element=select_model_element)
elements = OpenMEP.Element.MEPSystem.Elements(mepSystem=system)
