# Dynamo graph Pipe.CreateByLine.dyn (Dynamo 2.16.1.2727)
# packages: OpenMEP 1.0.0

select_model_element = DSModelElementSelection()  # 1 picked in the model
getUnusedConnectors = OpenMEP.ConnectorManager.Connector.GetUnusedConnectors(element=select_model_element)
radius = OpenMEP.ConnectorManager.Connector.Radius(connector=getUnusedConnectors)
code_block = CodeBlock(x=radius) { x*2; }
element_classes = ElementTypes("PipingSystemType")
all_elements_of_class = ElementsOfType(element_class=element_classes)
firstItem = List.FirstItem(list=all_elements_of_class)
element_classes_2 = ElementTypes("PipeType")
all_elements_of_class_2 = ElementsOfType(element_class=element_classes_2)
firstItem_2 = List.FirstItem(list=all_elements_of_class_2)
levels = Levels("Level 1")
select_model_element_2 = DSModelElementSelection()  # 1 picked in the model
getUnusedConnectors_2 = OpenMEP.ConnectorManager.Connector.GetUnusedConnectors(element=select_model_element_2)
origin = OpenMEP.ConnectorManager.Connector.Origin(connector=getUnusedConnectors_2)
origin_2 = OpenMEP.ConnectorManager.Connector.Origin(connector=getUnusedConnectors)
byStartPointEndPoint = Line.ByStartPointEndPoint(startPoint=origin, endPoint=origin_2)
createByLine = OpenMEP.Element.Pipe.CreateByLine(systemType=firstItem, pipeType=firstItem_2, level=levels, line=byStartPointEndPoint)
