# Dynamo graph Pipe.CreateByTwoConnectorDiameter.dyn (Dynamo 2.16.1.2727)
# packages: OpenMEP 1.0.0

element_classes = ElementTypes("PipeType")
all_elements_of_class = ElementsOfType(element_class=element_classes)
firstItem = List.FirstItem(list=all_elements_of_class)
levels = Levels("Level 1")
select_model_element = DSModelElementSelection()  # 1 picked in the model
getUnusedConnectors = OpenMEP.ConnectorManager.Connector.GetUnusedConnectors(element=select_model_element)
select_model_element_2 = DSModelElementSelection()  # 1 picked in the model
getUnusedConnectors_2 = OpenMEP.ConnectorManager.Connector.GetUnusedConnectors(element=select_model_element_2)
radius = OpenMEP.ConnectorManager.Connector.Radius(connector=getUnusedConnectors_2)
code_block = CodeBlock(x=radius) { x*2; }
createByTwoConnector = OpenMEP.Element.Pipe.CreateByTwoConnector(pipeType=firstItem, level=levels, connector1=getUnusedConnectors, connector2=getUnusedConnectors_2, diameter=code_block)
