# Dynamo graph Pipe.CreateRouteShortestByPoints.dyn (Dynamo 2.16.1.2727)
# packages: OpenMEP 1.0.0

element_classes = ElementTypes("PipingSystemType")
all_elements_of_class = ElementsOfType(element_class=element_classes)
firstItem = List.FirstItem(list=all_elements_of_class)
element_classes_2 = ElementTypes("PipeType")
all_elements_of_class_2 = ElementsOfType(element_class=element_classes_2)
firstItem_2 = List.FirstItem(list=all_elements_of_class_2)
levels = Levels("Level 1")
select_model_elements = DSModelElementsSelection()  # 4 picked in the model
getLocation = Element.GetLocation(element=select_model_elements)
code_block = CodeBlock { 50; }
createRouteShortestByPoints = OpenMEP.Element.Pipe.CreateRouteShortestByPoints(systemType=firstItem, pipeType=firstItem_2, level=levels, points=getLocation, diameter=code_block)
