# Dynamo graph Family.IsOwnerFamily.dyn (Dynamo 2.16.1.2727)
# packages: OpenMEP 1.0.0

code_block = CodeBlock()  # // Select a family instance
select_model_element = DSModelElementSelection()  # 1 picked in the model
elementType = Element.ElementType(element=select_model_element)
family = FamilyType.Family(familyType=elementType)
isOwnerFamily = OpenMEP.Element.Family.Family.IsOwnerFamily(family=family)
