# Dynamo graph BoundingBox.ByBoundingBoxs.dyn (Dynamo 2.17.3.4871)
# packages: OpenMEP 1.0.0

code_block = CodeBlock { 0..100..10; }
byCoordinates = Point.ByCoordinates(x=code_block, y=code_block, z=code_block, lacing=CrossProduct)
flatten = List.Flatten(list=byCoordinates)
code_block_2 = CodeBlock(a=flatten) { a[0..200]; }
byPoints = OpenMEPSandbox.Geometry.Abstract.BoundingBox.ByPoints(points=code_block_2)
code_block_3 = CodeBlock(a=flatten) { a[200..400]; }
byPoints_2 = OpenMEPSandbox.Geometry.Abstract.BoundingBox.ByPoints(points=code_block_3)
list_create = List.Create(item0=byPoints, item1=byPoints_2)
byBoundingBoxs = OpenMEPSandbox.Geometry.Abstract.BoundingBox.ByBoundingBoxs(boundingBoxes=list_create)
toCuboid = BoundingBox.ToCuboid(boundingBox=byBoundingBoxs)
