# Dynamo graph BoundingBox.Center.dyn (Dynamo 2.17.3.4871)
# packages: OpenMEP 1.0.0

code_block = CodeBlock { 0..100..10; }
byCoordinates = Point.ByCoordinates(x=code_block, y=code_block, z=code_block, lacing=CrossProduct)
flatten = List.Flatten(list=byCoordinates)
byPoints = OpenMEPSandbox.Geometry.Abstract.BoundingBox.ByPoints(points=flatten)
center = OpenMEPSandbox.Geometry.Abstract.BoundingBox.Center(boundingBox=byPoints)
