# Dynamo graph BoundingBox.Divide.dyn (Dynamo 2.17.3.4871)
# packages: OpenMEP 1.0.0

code_block = CodeBlock { 0..100..10; }
byCoordinates = Point.ByCoordinates(x=code_block, y=code_block, z=code_block, lacing=CrossProduct)
flatten = List.Flatten(list=byCoordinates)
byPoints = OpenMEPSandbox.Geometry.Abstract.BoundingBox.ByPoints(points=flatten)
number_slider = DoubleSlider(2, range=1..10 step 1)
divide = OpenMEPSandbox.Geometry.Abstract.BoundingBox.Divide(boundingBox=byPoints, value=number_slider)
visualize = OpenMEPSandbox.Geometry.Abstract.BoundingBox.Visualize(boundingBox=divide)
