# Dynamo graph BoundingBox.DivideByWidthAndLength.dyn (Dynamo 2.17.3.4871)
# packages: OpenMEP 1.0.0

code_block = CodeBlock { 0..100..10; }
byCoordinates = Point.ByCoordinates(x=code_block, y=code_block, z=code_block, lacing=CrossProduct)
flatten = List.Flatten(list=byCoordinates)
byPoints = OpenMEPSandbox.Geometry.Abstract.BoundingBox.ByPoints(points=flatten)
number_slider = DoubleSlider(5, range=1..10 step 1)
number_slider_2 = DoubleSlider(6, range=1..10 step 1)
divideByWidthAndLength = OpenMEPSandbox.Geometry.Abstract.BoundingBox.DivideByWidthAndLength(boundingBox=byPoints, width=number_slider, length=number_slider_2)
visualize = OpenMEPSandbox.Geometry.Abstract.BoundingBox.Visualize(boundingBox=divideByWidthAndLength)
