# Dynamo graph BoundingBox.DivideByWidthLengthHeight.dyn (Dynamo 2.17.3.4871)
# packages: OpenMEP 1.0.0

code_block = CodeBlock { 0..100..10; }
byCoordinates = Point.ByCoordinates(x=code_block, y=code_block, z=code_block, lacing=CrossProduct)
flatten = List.Flatten(list=byCoordinates)
byPoints = OpenMEPSandbox.Geometry.Abstract.BoundingBox.ByPoints(points=flatten)
number_slider = DoubleSlider(3, range=1..10 step 1)
number_slider_2 = DoubleSlider(3, range=1..10 step 1)
number_slider_3 = DoubleSlider(2, range=1..10 step 1)
divideByWidthLengthHeight = OpenMEPSandbox.Geometry.Abstract.BoundingBox.DivideByWidthLengthHeight(boundingBox=byPoints, width=number_slider, length=number_slider_2, height=number_slider_3)
visualize = OpenMEPSandbox.Geometry.Abstract.BoundingBox.Visualize(boundingBox=divideByWidthLengthHeight)
