# Dynamo graph BoundingBox.Scale.dyn (Dynamo 2.17.3.4871)
# packages: OpenMEP 1.0.0

code_block = CodeBlock { 0..100..10; }
byCoordinates = Point.ByCoordinates(x=code_block, y=code_block, z=code_block, lacing=CrossProduct)
flatten = List.Flatten(list=byCoordinates)
byPoints = OpenMEPSandbox.Geometry.Abstract.BoundingBox.ByPoints(points=flatten)
code_block_2 = CodeBlock { 0.2; }
scale = OpenMEPSandbox.Geometry.Abstract.BoundingBox.Scale(boundingBox=byPoints, value=code_block_2)
visualize = OpenMEPSandbox.Geometry.Abstract.BoundingBox.Visualize(boundingBox=scale)
