# Dynamo graph CoordinateSystem.Display.dyn (Dynamo 2.16.1.2727)
# packages: OpenMEP 1.0.0

integer_slider = IntegerSlider(1, range=0..100 step 1)
integer_slider_2 = IntegerSlider(31, range=0..100 step 1)
code_block = CodeBlock(nPeriods=integer_slider, nPts=integer_slider_2) { 0..nPeriods..#nPts; 0..(Math.PI*nPeriods)..#nPts; }
radiansToDegrees = Math.RadiansToDegrees(radians=code_block.out1)
sin = Math.Sin(angle=radiansToDegrees)
byCoordinates = Point.ByCoordinates(x=code_block.out0, z=sin)
byPoints = NurbsCurve.ByPoints(points=byCoordinates)
number_slider = DoubleSlider(0, range=0..1 step 0.1)
pointAtParameter = Curve.PointAtParameter(curve=byPoints, param=number_slider)
byOrigin = CoordinateSystem.ByOrigin(origin=pointAtParameter)
code_block_2 = CodeBlock { 1; }
display = OpenMEPSandbox.Geometry.CoordinateSystem.Display(coordinateSystem=byOrigin, length=code_block_2)
code_block_3 = CodeBlock(x=display.Display) { x; }
