# Dynamo graph Curve.BezierSegment.dyn (Dynamo 2.17.2.4543)
# packages: OpenMEP 1.0.0

code_block = CodeBlock { 10; }
byCoordinates = Point.ByCoordinates()
code_block_2 = CodeBlock { 5; }
byCoordinates_2 = Point.ByCoordinates(x=code_block_2, z=code_block_2)
number_slider = DoubleSlider(11.4, range=0..100 step 0.1)
byCoordinates_3 = Point.ByCoordinates(x=number_slider, z=number_slider)
code_block_3 = CodeBlock { 20; }
byCoordinates_4 = Point.ByCoordinates(x=code_block_3)
bezierSegment = OpenMEPSandbox.Geometry.Curve.BezierSegment(start=byCoordinates, startHandler=byCoordinates_2, endHandler=byCoordinates_3, end=byCoordinates_4)
code_block_4 = CodeBlock { DSCore.Color.ByARGB(255,255,0,0); }
byGeometryColor = Modifiers.GeometryColor.ByGeometryColor(geometry=bezierSegment, color=code_block_4)
