# Dynamo graph Curve.ToPoints.dyn (Dynamo 2.17.2.4543)
# packages: OpenMEP 1.0.0

byCoordinates = Point.ByCoordinates()
code_block = CodeBlock { 100; }
byCoordinates_2 = Point.ByCoordinates(y=code_block)
byStartPointEndPoint = Line.ByStartPointEndPoint(startPoint=byCoordinates, endPoint=byCoordinates_2)
code_block_2 = CodeBlock { 10; }
toPoints = OpenMEPSandbox.Geometry.Curve.ToPoints(curve=byStartPointEndPoint, numPoints=code_block_2)
