# Dynamo graph Geometry.SideSurface.dyn (Dynamo 2.18.0.4470)
# packages: OpenMEP 1.0.0

code_block = CodeBlock { 10; }
byLengths = Cuboid.ByLengths(width=code_block, length=code_block, height=code_block)
sideSurface = OpenMEPSandbox.Geometry.Geometry.SideSurface(geometry=byLengths)
