# Dynamo graph Graph.GetShortestPath.dyn (Dynamo 2.17.2.4543)
# packages: OpenMEP 1.0.0

code_block = CodeBlock { [0,0,100,100,100,200,300,300]; [100,300,200,300,400,100,200,400]; }
indexTwoListValues = OpenMEPSandbox.List.Generate.IndexTwoListValues(lst1=code_block.out0, lst2=code_block.out1)
code_block_2 = CodeBlock { [0,0,1,1,1,2,3,3]; [1,3,2,3,4,1,2,4]; [6,7,5,8,-4,-2,-3,9]; startNode =0; }
addEdge = OpenMEPSandbox.Geometry.Graph.AddEdge(sources=indexTwoListValues.lst1, destinations=indexTwoListValues.lst2, weights=code_block_2.out2)
endNode = IntegerSlider(4, range=0..4 step 1)
getShortestPath = OpenMEPSandbox.Geometry.Graph.GetShortestPath(bellmanFord=addEdge, startNode=code_block_2.startNode, endNode=endNode)
