# Dynamo graph Graph.ShortestPath.dyn (Dynamo 2.18.0.2986)
# packages: OpenMEP 1.0.0

code_block = CodeBlock()
# ---------- code_block.designscript (4 lines) ----------
Autodesk.Point.ByCoordinates(0,0);
Autodesk.Point.ByCoordinates(1,1);
Autodesk.Point.ByCoordinates(2,2);
Autodesk.Point.ByCoordinates(0,0);
# ----------------------------------------
list_create = List.Create(item0=code_block.out0, item1=code_block.out1, item2=code_block.out2, item3=code_block.out3)
code_block_2 = CodeBlock()
# ---------- code_block_2.designscript (4 lines) ----------
Autodesk.Point.ByCoordinates(1,1);
Autodesk.Point.ByCoordinates(2,2);
Autodesk.Point.ByCoordinates(3,3);
Autodesk.Point.ByCoordinates(2,2);
# ----------------------------------------
list_create_2 = List.Create(item0=code_block_2.out0, item1=code_block_2.out1, item2=code_block_2.out2, item3=code_block_2.out3)
addEdge = OpenMEPSandbox.Geometry.Graph.AddEdge(u=list_create, v=list_create_2)
shortestPath = OpenMEPSandbox.Geometry.Graph.ShortestPath(dijkstraGraph=addEdge, start=code_block.out0, end=code_block_2.out2)
code_block_3 = CodeBlock { 0.5; }
byCenterPointRadius = Circle.ByCenterPointRadius(centerPoint=shortestPath, radius=code_block_3)
