# Dynamo graph Line.BottomPoint.dyn (Dynamo 2.18.0.2986)
# packages: OpenMEP 1.0.0

byCoordinates = Point.ByCoordinates()
code_block = CodeBlock { 10; }
byCoordinates_2 = Point.ByCoordinates(x=code_block, y=code_block, z=code_block)
byStartPointEndPoint = Line.ByStartPointEndPoint(startPoint=byCoordinates, endPoint=byCoordinates_2)
bottomPoint = OpenMEPSandbox.Geometry.Line.BottomPoint(line=byStartPointEndPoint)
