# Dynamo graph Line.Extend.dyn (Dynamo 2.18.0.2986)
# packages: OpenMEP 1.0.0

byCoordinates = Point.ByCoordinates()
code_block = CodeBlock { 10; }
byCoordinates_2 = Point.ByCoordinates(x=code_block)
byStartPointEndPoint = Line.ByStartPointEndPoint(startPoint=byCoordinates, endPoint=byCoordinates_2)
code_block_2 = CodeBlock { 0; }
code_block_3 = CodeBlock { 10; }
extend = OpenMEPSandbox.Geometry.Line.Extend(line=byStartPointEndPoint, startLength=code_block_2, endLength=code_block_3)
