# Dynamo graph Point.Ceiling.dyn (Dynamo 2.17.2.4543)
# packages: OpenMEP 1.0.0

code_block = CodeBlock { 35.6; }
byCoordinates = Point.ByCoordinates(x=code_block, y=code_block, z=code_block)
ceiling = OpenMEPSandbox.Geometry.Point.Ceiling(point=byCoordinates)
