# Dynamo graph Point.Centroid.dyn (Dynamo 2.16.1.2727)
# packages: OpenMEP 1.0.0

code_block = CodeBlock { 10; }
byCenterPointRadius = Circle.ByCenterPointRadius(radius=code_block)
regularPolygon = Polygon.RegularPolygon(circle=byCenterPointRadius)
corners = Polygon.Corners(polygon=regularPolygon)
number_slider = DoubleSlider(0, range=0..100 step 0.1)
translate = Geometry.Translate(geometry=corners, zTranslation=number_slider)
centroid = OpenMEP.Geometry.Point.Centroid(points=translate)
byIndices = IndexGroup.ByIndices()  # unwired: a, b, c, d
boolean = BoolSelector(true)
byPoints = PolyCurve.ByPoints(points=translate, connectLastToFirst=boolean)
