# Dynamo graph Point.CompareTo.dyn (Dynamo 2.18.0.2986)
# packages: OpenMEP 1.0.0

byCoordinates = Point.ByCoordinates()
code_block = CodeBlock { 10; }
byCoordinates_2 = Point.ByCoordinates(y=code_block)
compareTo = OpenMEPSandbox.Geometry.Point.CompareTo(point1=byCoordinates, point2=byCoordinates_2)
