# Dynamo graph Point.Deconstruct.dyn (Dynamo 2.16.1.2727)
# packages: OpenMEP 1.0.0

code_block = CodeBlock { 10; }
byCoordinates = Point.ByCoordinates(x=code_block)
deconstruct = OpenMEPSandbox.Geometry.Point.Deconstruct(point=byCoordinates)
