# Dynamo graph Point.FindShortestRoute.dyn (Dynamo 2.18.0.2986)
# packages: OpenMEP 1.0.0

code_block = CodeBlock()
# ---------- code_block.designscript (6 lines) ----------
Autodesk.Point.ByCoordinates(0,0,0);
Autodesk.Point.ByCoordinates(0,5,0);
Autodesk.Point.ByCoordinates(5,5,0);
Autodesk.Point.ByCoordinates(5,2,0);
Autodesk.Point.ByCoordinates(2,0,0);
Autodesk.Point.ByCoordinates(2,4,0);
# ----------------------------------------
list_create = List.Create(item0=code_block.out0, item1=code_block.out1, item2=code_block.out4, item3=code_block.out3, item4=code_block.out2, item5=code_block.out5)
findShortestRoute = OpenMEPSandbox.Geometry.Point.FindShortestRoute(points=list_create)
