# Dynamo graph Point.GenerateRandomPointsInCube.dyn (Dynamo 2.18.0.2986)
# packages: OpenMEP 1.0.0

code_block = CodeBlock { 10; }
integer_slider = IntegerSlider(1950, range=0..2000 step 50)
generateRandomPointsInCube = OpenMEPSandbox.Geometry.Point.GenerateRandomPointsInCube(width=code_block, height=code_block, length=code_block, numPoints=integer_slider)
