# Dynamo graph Point.IsInPolygon.dyn "Point.IsInPolyGon" (Dynamo 2.16.1.2727)
# packages: OpenMEP 1.0.0

number_slider = DoubleSlider(11.8, range=0..100 step 0.1)
byCoordinates = Point.ByCoordinates(x=number_slider)
code_block = CodeBlock { 10; }
byCenterPointRadius = Circle.ByCenterPointRadius(radius=code_block)
regularPolygon = Polygon.RegularPolygon(circle=byCenterPointRadius)
isInPolyGon = OpenMEPSandbox.Geometry.Point.IsInPolyGon(point=byCoordinates, polygon=regularPolygon)
corners = Polygon.Corners(polygon=regularPolygon)
