# Dynamo graph Point.IsOnLine.dyn (Dynamo 2.16.1.2727)
# packages: OpenMEP 1.0.0

number_slider = DoubleSlider(3, range=0..20 step 1)
byCoordinates = Point.ByCoordinates(x=number_slider)
number_slider_2 = DoubleSlider(0, range=0..100 step 0.1)
byCoordinates_2 = Point.ByCoordinates(x=number_slider_2)
number_slider_3 = DoubleSlider(10, range=0..100 step 0.1)
byCoordinates_3 = Point.ByCoordinates(x=number_slider_3)
byStartPointEndPoint = Line.ByStartPointEndPoint(startPoint=byCoordinates_2, endPoint=byCoordinates_3)
isOnLine = OpenMEP.Geometry.Point.IsOnLine(point=byCoordinates, line=byStartPointEndPoint)
