# Dynamo graph Point.Offset.dyn (Dynamo 2.16.1.2727)
# packages: OpenMEP 1.0.0

origin = OpenMEPSandbox.Geometry.Point.Origin()
number_slider = DoubleSlider(22.1, range=0..100 step 0.1)
XAxis = Vector.XAxis()
offset = OpenMEPSandbox.Geometry.Point.Offset(point=origin, distance=number_slider, direction=XAxis)
byStartPointEndPoint = Line.ByStartPointEndPoint(startPoint=offset, endPoint=origin)
