# Dynamo graph Point.ProjectOnToLine.dyn (Dynamo 2.18.0.2986)
# packages: OpenMEP 1.0.0

integer_slider = IntegerSlider(28, range=1..30 step 1)
byCoordinates = Point.ByCoordinates(x=integer_slider, y=integer_slider)
byCoordinates_2 = Point.ByCoordinates()
code_block = CodeBlock { 10; }
byCoordinates_3 = Point.ByCoordinates(x=code_block, z=code_block)
byStartPointEndPoint = Line.ByStartPointEndPoint(startPoint=byCoordinates_2, endPoint=byCoordinates_3)
projectOnToLine = OpenMEPSandbox.Geometry.Point.ProjectOnToLine(point=byCoordinates, line=byStartPointEndPoint)
byStartPointEndPoint_2 = Line.ByStartPointEndPoint(startPoint=byCoordinates, endPoint=projectOnToLine)
