# Dynamo graph Point.ProjectOntoPlane.dyn (Dynamo 2.16.1.2727)
# packages: OpenMEP 1.0.0

byOriginNormal = Plane.ByOriginNormal()
normal = Plane.Normal(plane=byOriginNormal)
XAxis = Vector.XAxis()
cross = Vector.Cross(vector=normal, cross=XAxis)
byOriginNormal_2 = Plane.ByOriginNormal(normal=cross)
code_block = CodeBlock { 20; }
byPlaneRadius = Circle.ByPlaneRadius(plane=byOriginNormal_2, radius=code_block)
byPatch = Surface.ByPatch(closedCurve=byPlaneRadius)
number_slider = DoubleSlider(-50, range=-50..50 step 3)
byCoordinates = Point.ByCoordinates(x=number_slider, y=number_slider)
projectOntoPlane = OpenMEP.Geometry.Point.ProjectOntoPlane(point=byCoordinates, planeNormal=cross)
byStartPointEndPoint = Line.ByStartPointEndPoint(startPoint=byCoordinates, endPoint=projectOntoPlane)
