# Dynamo graph Point.SortPointsByClockwise.dyn (Dynamo 2.17.2.4543)
# packages: OpenMEP 1.0.0

code_block = CodeBlock { 1; -1; 0; }
byCoordinates = Point.ByCoordinates(x=code_block.out0, y=code_block.out0, z=code_block.out2)
byCoordinates_2 = Point.ByCoordinates(x=code_block.out1, y=code_block.out0, z=code_block.out2)
byCoordinates_3 = Point.ByCoordinates(x=code_block.out1, y=code_block.out1)
byCoordinates_4 = Point.ByCoordinates(x=code_block.out0, y=code_block.out1, z=code_block.out2)
code_block_2 = CodeBlock { 2..3; }
byCoordinates_5 = Point.ByCoordinates(x=code_block.out1, y=code_block.out1, z=code_block_2)
list_create = List.Create(item0=byCoordinates, item1=byCoordinates_2, item2=byCoordinates_3, item3=byCoordinates_4, item4=byCoordinates_5)
flatten = List.Flatten(list=list_create)
code_block_3 = CodeBlock { 0; }
sortPointsByClockwise = OpenMEPSandbox.Geometry.Point.SortPointsByClockwise(points=flatten, startAngle=code_block_3)
