# Dynamo graph Point.SortPointsByDirection.dyn (Dynamo 2.17.2.4543)
# packages: OpenMEP 1.0.0

code_block = CodeBlock { 10; }
code_block_2 = CodeBlock { 1; 10; 1; }
randomList = Math.RandomList(amount=code_block, value1=code_block_2.out0, value2=code_block_2.out1, seed=code_block_2.out2)
byCoordinates = Point.ByCoordinates(x=randomList, y=randomList, z=randomList)
XAxis = Vector.XAxis()
sortPointsByDirection = OpenMEPSandbox.Geometry.Point.SortPointsByDirection(points=byCoordinates, direction=XAxis)
