# Dynamo graph Vector.Display.dyn (Dynamo 2.16.1.2727)
# packages: OpenMEP 1.0.0

ZAxis = Vector.ZAxis()
origin = OpenMEPSandbox.Geometry.Point.Origin()
code_block = CodeBlock { 1000; }
display = OpenMEPSandbox.Geometry.Vector.Display(vector=ZAxis, startPoint=origin, scale=code_block)
