# Dynamo graph Vector.IsOppositeDirection.dyn (Dynamo 2.16.1.2727)
# packages: OpenMEP 1.0.0

byCoordinates = Point.ByCoordinates()
code_block = CodeBlock { 10; }
byCoordinates_2 = Point.ByCoordinates(z=code_block)
byStartPointEndPoint = Line.ByStartPointEndPoint(startPoint=byCoordinates, endPoint=byCoordinates_2)
direction = Line.Direction(line=byStartPointEndPoint)
number_slider = DoubleSlider(10, range=-10..10 step 1)
byCoordinates_3 = Point.ByCoordinates(x=number_slider)
number_slider_2 = DoubleSlider(0, range=0..10 step 1)
byCoordinates_4 = Point.ByCoordinates(x=number_slider, y=number_slider_2, z=code_block)
byStartPointEndPoint_2 = Line.ByStartPointEndPoint(startPoint=byCoordinates_3, endPoint=byCoordinates_4)
direction_2 = Line.Direction(line=byStartPointEndPoint_2)
reverse = Vector.Reverse(vector=direction_2)
isOppositeDirection = OpenMEPSandbox.Geometry.Vector.IsOppositeDirection(v1=direction, v2=reverse)
