# Dynamo graph GraphVisualizer.Visualize.dyn (Dynamo 2.17.2.4543)
# packages: Dynamo Text 2.0.1, OpenMEP 1.0.0

number_slider = DoubleSlider(7.58, range=0..10 step 0.01)
code_block = CodeBlock(x=number_slider)
# ---------- code_block.designscript (7 lines) ----------
startNode =0;
// source and destinations
// same with lst1 and lst2
[0,0,1,1,1,2,3,3];
[1,3,2,3,4,1,2,4];
//Distance
[6,x,5,8,1,1,1,13,9];
# ----------------------------------------
visualizeByGraph = OpenMEPSandbox.Graph.GraphVisualizer.VisualizeByGraph(sources=code_block.out1, destinations=code_block.out2, weights=code_block.out3)
code_block_2 = CodeBlock { 1; }
# note: Dynamo Text Pacage
fromStringOriginAndScale = DynamoText.Text.FromStringOriginAndScale(text=visualizeByGraph.Node, origin=visualizeByGraph.Point, scale=code_block_2)
