# Dynamo graph Path.GetDistancesPathFromNode.dyn (Dynamo 2.17.2.4543)
# packages: OpenMEP 1.0.0

fromNode = IntegerSlider(0, range=0..4 step 1)
code_block = CodeBlock { [0,0,1,1,1,2,3,3]; [1,3,2,3,4,1,2,4]; [6,7,5,8,-4,-2,-3,9]; startNode =0; }
getDistancesPathFromNode = OpenMEPSandbox.Graph.Path.GetDistancesPathFromNode(from=fromNode, sources=code_block.out0, destinations=code_block.out1, weights=code_block.out2)
