# Dynamo graph Generate.IndexListObjects.dyn (Dynamo 2.17.2.4543)
# packages: OpenMEP 1.0.0

code_block = CodeBlock { [100,200,300,200,100,300]; }
indexListObjects = OpenMEPSandbox.List.Generate.IndexListObjects(strings=code_block)
code_block_2 = CodeBlock { ["Red","Green","Blue","Green"]; }
indexListObjects_2 = OpenMEPSandbox.List.Generate.IndexListObjects(strings=code_block_2)
