# Dynamo graph Generate.IndexTwoListObjects.dyn (Dynamo 2.17.2.4543)
# packages: OpenMEP 1.0.0

code_block = CodeBlock { [100,200,300,200,100,300]; }
code_block_2 = CodeBlock { [400,500,200,300,400]; }
indexTwoListObjects = OpenMEPSandbox.List.Generate.IndexTwoListObjects(lst1=code_block, lst2=code_block_2)
code_block_3 = CodeBlock { 1..10; }
byCoordinates = Point.ByCoordinates(x=code_block_3)
code_block_4 = CodeBlock { 5..10; }
byCoordinates_2 = Point.ByCoordinates(x=code_block_4)
indexTwoListObjects_2 = OpenMEPSandbox.List.Generate.IndexTwoListObjects(lst1=byCoordinates, lst2=byCoordinates_2)
