# Dynamo graph Generate.IndexTwoListStrings.dyn (Dynamo 2.17.2.4543)
# packages: OpenMEP 1.0.0

code_block = CodeBlock { ["apple","banana","orange","banana","orange"]; }
code_block_2 = CodeBlock { ["orange","banana","mango","banana","orange"]; }
indexTwoListStrings = OpenMEPSandbox.List.Generate.IndexTwoListStrings(list1=code_block, list2=code_block_2)
