# Dynamo graph Generate.IndexTwoListValues.dyn (Dynamo 2.17.2.4543)
# packages: OpenMEP 1.0.0

code_block = CodeBlock { [100,200,300,200,100,300]; }
code_block_2 = CodeBlock { [400,500,200,300,400]; }
indexTwoListValues = OpenMEPSandbox.List.Generate.IndexTwoListValues(lst1=code_block, lst2=code_block_2)
