# Dynamo graph Generate.IndexUniqueListObjects.dyn (Dynamo 2.17.2.4543)
# packages: OpenMEP 1.0.0

code_block = CodeBlock { [100,200,300,100]; }
indexUniqueListObjects = OpenMEPSandbox.List.Generate.IndexUniqueListObjects(lst=code_block)
code_block_2 = CodeBlock { ["Red","Green","Blue","Red"]; }
indexUniqueListObjects_2 = OpenMEPSandbox.List.Generate.IndexUniqueListObjects(lst=code_block_2)
