# Dynamo graph Generate.UniqueNamesIndexList.dyn (Dynamo 2.17.2.4543)
# packages: OpenMEP 1.0.0

code_block = CodeBlock { ["Red","Green","Blue","Red"]; }
code_block_2 = CodeBlock { ["X","Blue","Green","Blue"]; }
uniqueNamesIndexList = OpenMEPSandbox.List.Generate.UniqueNamesIndexList(list1=code_block, list2=code_block_2)
